# Grasshopper definition ExampleComponentTests.ghx (Grasshopper 1.0.7)
# plug-ins: PancakeContract, GrasshopperBootstrap

# ----
# This is an example of how to setup unit and integration tests within Grasshopper. It uses the Pancake Contract plugin to create and check various assertions.
# 
# You can download Pancake Contract at https://www.food4rhino.com/app/pancakecontrac
# 
# Note that comparing most types of internalised geometry to generated geometry will fail all tests except "structure". So most of the cases here compare values that can be inferred from the geometry (e.g. points, lengths)
panel = Panel("Test Points")
testcomponent = TestComponent(
    Plane=PlaneXY(0, 0, 0),
    InnerRadius=Slider(10, range=0..10),
    OuterRadius=Slider(100, range=0..100),
    Turns=Slider(5, range=0..10))
component_output = Geometry(testcomponent)
prior_output = Geometry(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)
explode = Explode(Curve=prior_output, Recursive=True)  # -> Segments, Vertices
explode_2 = Explode(Curve=component_output, Recursive=True)  # -> Segments, Vertices
length = Length(Curve=explode.Segments)
length_2 = Length(Curve=explode_2.Segments)

panel_2 = Panel("Test Failure Case")
testcomponent_2 = TestComponent(Plane=PlaneXY(0, 0, 0), InnerRadius=Slider(10, range=0..10), OuterRadius=10, Turns=Slider(5, range=0..10))
null_item = NullItem(Item=testcomponent_2)  # -> NullFlags, InvalidFlags, Description

panel_3 = Panel("Test Default Case")
testcomponent_3 = TestComponent(Plane=PlaneXY(0, 0, 0), InnerRadius=1, OuterRadius=10, Turns=10)
component_output_2 = Geometry(testcomponent_3)
component_output_3 = Geometry(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)
explode_3 = Explode(Curve=component_output_3, Recursive=True)  # -> Segments, Vertices
explode_4 = Explode(Curve=component_output_2, Recursive=True)  # -> Segments, Vertices
length_3 = Length(Curve=explode_3.Segments)
length_4 = Length(Curve=explode_4.Segments)

assert_true = AssertTrue(_0=null_item.NullFlags)  # -> Satisfied, ExtraInfo
assert_identical = AssertIdentical(_0=length_3, _1=length_4)  # -> Satisfied, ExtraInfo
assert_identical_2 = AssertIdentical(_0=explode_3.Vertices, _1=explode_4.Vertices)  # -> Satisfied, ExtraInfo
assert_identical_3 = AssertIdentical(_0=length, _1=length_2)  # -> Satisfied, ExtraInfo
assert_identical_4 = AssertIdentical(_0=explode.Vertices, _1=explode_2.Vertices)  # -> Satisfied, ExtraInfo
